# Grasshopper definition Test_Fr.gh (Grasshopper 0.9.76)
# Copyright: Ángel Linares García 2014
# plug-ins: GH2SAP

# Abre un archivo vacío de SAP y dale al toggle
set_me_true = BooleanToggle(False)

panel = Panel("""10
4""")
pt = ConstructPoint(XCoordinate=panel, YCoordinate=graft(panel), ZCoordinate=0)  # -> flatten(Point)
pt_2 = ConstructPoint(XCoordinate=0, YCoordinate=0, ZCoordinate=0)
ln = Line(StartPoint=pt_2, EndPoint=pt)

io = IO(IO=set_me_true, Mode=0, Link=True, Path="F:\GH2SAP\DocumentName.sdb")  # -> Message, Flag
frimp = FrImport(Frame=ln, FrameSection="Sec_1", Name="FrameElemt", Start=io.Flag)
